# Grasshopper definition KeremDUZENLI_PythonScripting.gh (Grasshopper 1.0.7)

numframes = Slider(100, range=0..100)
point = Point(<point referenced from the Rhino model>)
point_2 = Point(<point referenced from the Rhino model>)
number_slider = Slider(3.8, range=0..10)
geometry = Geometry(<curve referenced from the Rhino model>)
ghpython_script = GhPythonScript(
    Nokta_2=point_2,
    Boyut=number_slider,
    Hareket_Oranı=Slider(0.978, range=0..1),
    Rastgelelik_Oranı=Slider(36388, range=0..100000))  # -> out, Noktalar
# ---------- ghpython_script: Python ----------
import rhinoscriptsyntax as rs
from Rhino.Geometry import Point3d
import random


random.seed(Rastgelelik_Oranı)

Noktalar = []

Nokta_2 = rs.coerce3dpoint(Nokta_2)


def Box_Yap(Nokta_2, Tekrar):

    Noktalar.append(Nokta_2)

    Hareket_X = random.uniform(-Boyut * Hareket_Oranı, Boyut * Hareket_Oranı)
    Hareket_Y = random.uniform(-Boyut * Hareket_Oranı, Boyut * Hareket_Oranı)

    if Tekrar < 10:
        Hareket_Edilmiş_1 = Nokta_2 + Point3d(Hareket_X, Hareket_Y, Boyut)

        Box_Yap(Hareket_Edilmiş_1, Tekrar + 1)


        if abs(Hareket_X) > Boyut * 0.5 and abs(Hareket_Y) > Boyut * 0.5:
            Hareket_Edilmiş_2 = Nokta_2 + Point3d(-Hareket_X, -Hareket_Y, Boyut)

            Box_Yap(Hareket_Edilmiş_2, Tekrar + 1)


Box_Yap(Nokta_2, 0)
# ---------- end ghpython_script ----------
vector_xyz = VectorXYZ(XComponent=number_slider, YComponent=number_slider, ZComponent=number_slider)  # -> Vector, Length
ghpython_script_2 = GhPythonScript(Nokta_1=point, Nokta_2=point_2)  # -> out, Çizgi
# ---------- ghpython_script_2: Python ----------
import rhinoscriptsyntax as rs

print Nokta_1

Nokta_1 = rs.coerce3dpoint(Nokta_1)
Nokta_2 = rs.coerce3dpoint(Nokta_2)

Çizgi = rs.AddLine(Nokta_1, Nokta_2)

Sonuç = Çizgi
# ---------- end ghpython_script_2 ----------
divide_curve = DivideCurve(Curve=geometry, Count=numframes, Kinks=False)  # -> Points, Tangents, Parameters
animation_frame = Slider(100, range=0..100)
construct_domain = ConstructDomain(DomainStart=0, DomainEnd=animation_frame)
panel = Panel(ghpython_script_2.Çizgi)
sub_list = SubList(List=ghpython_script.Noktalar, Domain=construct_domain, Wrap=False)  # -> List, Index
move = Move(Geometry=sub_list.List, Hareket=vector_xyz.Vector)  # -> Geometry, Transform
list_item = ListItem(List=divide_curve.Points, Index=animation_frame, Wrap=True)
unit_z = UnitZ(Factor=Slider(20, range=0..20))
box_2pt = Box2Pt(PointA=sub_list.List, PointB=move.Geometry, Plane=PlaneXY(0, 0, 0))
point_3 = Point(<point referenced from the Rhino model>)
move_2 = Move(Geometry=point_3, Motion=unit_z)  # -> Geometry, Transform
ghpython_script_3 = GhPythonScript(location=list_item, target=move_2.Geometry)  # -> out, a
# ---------- ghpython_script_3: Python ----------
import rhinoscriptsyntax as rs
import scriptcontext as sc


sc.doc = ghdoc

loc = rs.coerce3dpoint(location)
tar = rs.coerce3dpoint(target)

vp = sc.doc.Views.ActiveView.ActiveViewport
vp.SetCameraLocation(loc, False)
vp.SetCameraDirection(tar - loc, True)
# ---------- end ghpython_script_3 ----------
ghpython_script_4 = GhPythonScript(active=Toggle(False), geo=box_2pt, layer="Kutular")  # -> out, C; inputs geo: list
# ---------- ghpython_script_4: Python ----------
import rhinoscriptsyntax as rs
import scriptcontext as sc
import Rhino



if active:
    for i in range(len(geo)):

        geo_id = geo[i]

        sc.doc = ghdoc

        doc_object = rs.coercerhinoobject(geo_id)
        print doc_object

        geometry = doc_object.Geometry

        attributes = doc_object.Attributes

        print geometry
        print attributes


        sc.doc = Rhino.RhinoDoc.ActiveDoc

        rhino_ref = sc.doc.Objects.Add(geometry, attributes)

        rs.ObjectLayer(rhino_ref, layer)

    C = True


else:
    C = False
# ---------- end ghpython_script_4 ----------
ghpython_script_5 = GhPythonScript(filePath="C:\Users\Kerem\Desktop\animation_vray\")  # -> out, C
# ---------- ghpython_script_5: Python ----------
import rhinoscriptsyntax as rs


if active:

    rs.Command("_Render")

    savedLocation = filePath + str(int(current)).zfill(4) + ".png"

    rs.Command("_-SaveRenderWindowAs \n\"" + savedLocation + "\"\n")
    rs.Command("_-CloseRenderWindow")

    C = True

else:
    C = False
# ---------- end ghpython_script_5 ----------
ghpython_script_6 = GhPythonScript(active=ghpython_script_5.C)  # -> out, a
# ---------- ghpython_script_6: Python ----------
import rhinoscriptsyntax as rs
import scriptcontext as sc
import Rhino



if active:
    sc.doc = Rhino.RhinoDoc.ActiveDoc

    objs = rs.ObjectsByLayer(layer)

    rs.DeleteObjects(objs)
# ---------- end ghpython_script_6 ----------
